# Grasshopper definition Fractal cubes.gh (Grasshopper 1.0.7)

number_slider = Slider(50, range=0..100)
number_slider_2 = Slider(50, range=0..100)
center_box = CenterBox(Base=PlaneXY(0, 0, 0), X=number_slider, Y=number_slider, Z=number_slider)
division = Division(A=number_slider, B=Slider(2, range=0..10))
center_box_2 = CenterBox(Base=PlaneXY(0, 0, 0), X=number_slider_2, Y=number_slider_2, Z=number_slider_2)
deconstruct_brep = DeconstructBrep(Brep=center_box)  # -> Faces, Edges, Vertices
deconstruct_brep_2 = DeconstructBrep(Brep=center_box_2)  # -> Faces, Edges, Vertices
division_2 = Division(A=number_slider_2, B=Slider(2, range=0..10))
division_3 = Division(A=number_slider_2, B=Slider(2, range=0..10))
center_box_3 = CenterBox(Base=deconstruct_brep.Edges, X=division, Y=division, Z=division)
area = Area(Geometry=deconstruct_brep_2.Faces)  # -> Area, Centroid
face_normals = FaceNormals(Mesh=deconstruct_brep_2.Faces)  # -> Centers, flatten(Normals)
multiplication = Multiplication(A=face_normals.Normals, B=division_2)
deconstruct_brep_3 = DeconstructBrep(Brep=center_box_3)  # -> Faces, Edges, Vertices
division_4 = Division(A=division, B=Slider(2, range=0..10))
center_box_4 = CenterBox(Base=area.Centroid, X=division_3, Y=division_3, Z=division_3)
merge = Merge(Data1=center_box_2, Data2=center_box_4)  # -> flatten(Result)
move = Move(Geometry=center_box_4, Motion=multiplication)  # -> Geometry, Transform
center_box_5 = CenterBox(Base=deconstruct_brep_3.Vertices, X=division_4, Y=division_4, Z=division_4)
volume = Volume(Geometry=center_box_5)  # -> Volume, Centroid
deconstruct_brep_4 = DeconstructBrep(Brep=move.Geometry)  # -> flatten(Faces), Edges, Vertices
point_in_brep = PointInBrep(Brep=center_box, Point=flatten(volume.Centroid), Strict=True)
division_5 = Division(A=division_4, B=Slider(2, range=0..10))
area_2 = Area(Geometry=deconstruct_brep_4.Faces)  # -> Area, Centroid
division_6 = Division(A=division_3, B=Slider(2, range=0..10))
dispatch = Dispatch(List=flatten(center_box_5), DispatchPattern=point_in_brep)  # -> ListA, ListB
merge_2 = Merge(Data1=move.Geometry, Data2=center_box_2)  # -> flatten(Result)
face_normals_2 = FaceNormals(Mesh=deconstruct_brep_4.Faces)  # -> Centers, Normals
multiplication_2 = Multiplication(A=face_normals_2.Normals, B=division_6)
center_box_6 = CenterBox(Base=area_2.Centroid, X=division_6, Y=division_6, Z=division_6)
brep = Brep(dispatch.ListA)
brep_2 = Brep(dispatch.ListB)
stream_filter = StreamFilter(
    Gate=Slider(0, range=0..3),
    Stream0=center_box,
    Stream1=[center_box, center_box_3],
    Stream2=[center_box, center_box_3, brep_2])
panel = Panel(dispatch.ListA)
move_2 = Move(Geometry=center_box_6, Motion=multiplication_2)  # -> Geometry, Transform
deconstruct_brep_5 = DeconstructBrep(Brep=brep_2)  # -> Faces, Edges, Vertices
center_box_7 = CenterBox(Base=deconstruct_brep_5.Vertices, X=division_5, Y=division_5, Z=division_5)
volume_2 = Volume(Geometry=center_box_7)  # -> Volume, Centroid
panel_2 = Panel(dispatch.ListB)
shape_in_brep = ShapeInBrep(Brep=merge_2, Shape=move_2.Geometry)  # -> expr("2", Relation)
dispatch_2 = Dispatch(List=move_2.Geometry, DispatchPattern=shape_in_brep)  # -> ListA, ListB
volume_3 = Volume()  # -> Volume, Centroid
point_in_brep_2 = PointInBrep(Point=flatten(volume_3.Centroid), Strict=True)
point_in_brep_3 = PointInBrep(Brep=center_box_3, Point=flatten(volume_2.Centroid), Strict=True)
dispatch_3 = Dispatch(List=flatten(center_box_7), DispatchPattern=point_in_brep_3)  # -> ListA, ListB
dispatch_4 = Dispatch(DispatchPattern=point_in_brep_2)  # -> ListA, ListB
brep_brep = BrepBrep()  # -> Curves, Points
brep_3 = Brep(dispatch_3.ListA)
brep_4 = Brep(dispatch_3.ListB)
brep_5 = Brep(dispatch_4.ListB)
brep_6 = Brep(dispatch_4.ListA)
panel_3 = Panel(dispatch_3.ListA)
panel_4 = Panel(dispatch_3.ListB)
