# Grasshopper definition Fractal_cubes_2.gh (Grasshopper 1.0.7)

number_slider = Slider(50, range=0..100)
center_box = CenterBox(Base=PlaneXY(0, 0, 0), X=number_slider, Y=number_slider, Z=number_slider)
deconstruct_brep = DeconstructBrep(Brep=center_box)  # -> Faces, Edges, Vertices
division = Division(A=number_slider, B=Slider(2, range=0..10))
area = Area(Geometry=deconstruct_brep.Faces)  # -> Area, Centroid
center_box_2 = CenterBox(Base=area.Centroid, X=division, Y=division, Z=division)
deconstruct_brep_2 = DeconstructBrep(Brep=center_box_2)  # -> Faces, Edges, Vertices
volume = Volume()  # -> Volume, Centroid
point_in_brep = PointInBrep(Point=flatten(volume.Centroid), Strict=True)
number_slider_2 = Slider(50, range=0..100)
dispatch = Dispatch(DispatchPattern=point_in_brep)  # -> ListA, ListB

center_box_3 = CenterBox(Base=PlaneXY(0, 0, 0), X=number_slider_2, Y=number_slider_2, Z=number_slider_2)
division_2 = Division(A=number_slider_2, B=Slider(2, range=0..10))
deconstruct_brep_3 = DeconstructBrep(Brep=center_box_3)  # -> Faces, Edges, Vertices

brep = Brep(dispatch.ListB)

# ---- group: RH_IN:size
number_slider_3 = Slider(22, range=0..100)

# ----
brep_2 = Brep(dispatch.ListA)

center_box_4 = CenterBox(Base=deconstruct_brep_3.Vertices, X=division_2, Y=division_2, Z=division_2)
deconstruct_brep_4 = DeconstructBrep(Brep=center_box_4)  # -> Faces, Edges, flatten(Vertices)
division_3 = Division(A=division_2, B=Slider(2, range=0..10))
point_in_breps = PointInBreps(Brep=center_box_3, Point=deconstruct_brep_4.Vertices, Strict=False)  # -> Inside, Index
dispatch_2 = Dispatch(List=deconstruct_brep_4.Vertices, DispatchPattern=point_in_breps.Inside)  # -> ListA, ListB

center_box_5 = CenterBox(Base=PlaneXY(0, 0, 0), X=number_slider_3, Y=number_slider_3, Z=number_slider_3)
deconstruct_brep_5 = DeconstructBrep(Brep=center_box_5)  # -> Faces, Edges, Vertices
division_4 = Division(A=number_slider_3, B=Slider(2, range=0..10))
division_5 = Division(A=number_slider_3, B=Slider(2, range=0..10))
area_2 = Area(Geometry=deconstruct_brep_5.Faces)  # -> Area, Centroid
face_normals = FaceNormals(Mesh=deconstruct_brep_5.Faces)  # -> Centers, flatten(Normals)
multiplication = Multiplication(A=face_normals.Normals, B=division_4)
center_box_6 = CenterBox(Base=area_2.Centroid, X=division_5, Y=division_5, Z=division_5)

center_box_7 = CenterBox(Base=dispatch_2.ListB, X=division_3, Y=division_3, Z=division_3)
merge = Merge(Data1=center_box_3, Data2=center_box_4)  # -> flatten(Result)
deconstruct_brep_6 = DeconstructBrep(Brep=center_box_7)  # -> Faces, Edges, flatten(Vertices)
division_6 = Division(A=division_3, B=Slider(2, range=0..10))
point_in_breps_2 = PointInBreps(Brep=merge, Point=deconstruct_brep_6.Vertices, Strict=False)  # -> Inside, Index
dispatch_3 = Dispatch(List=deconstruct_brep_6.Vertices, DispatchPattern=point_in_breps_2.Inside)  # -> ListA, ListB

move = Move(Geometry=center_box_6, Motion=multiplication)  # -> Geometry, Transform
deconstruct_brep_7 = DeconstructBrep(Brep=move.Geometry)  # -> flatten(Faces), Edges, Vertices
area_3 = Area(Geometry=deconstruct_brep_7.Faces)  # -> Area, Centroid
division_7 = Division(A=division_5, B=Slider(2, range=0..10))
division_8 = Division(A=division_7, B=Slider(2, range=0..10))
division_9 = Division(A=division_8, B=Slider(2, range=0..10))
division_10 = Division(A=division_9, B=Slider(2, range=0..10))
face_normals_2 = FaceNormals(Mesh=deconstruct_brep_7.Faces)  # -> Centers, flatten(Normals)

merge_2 = Merge(Data1=center_box_3, Data2=center_box_4, Data3=center_box_7)  # -> flatten(Result)
center_box_8 = CenterBox(Base=dispatch_3.ListB, X=division_6, Y=division_6, Z=division_6)
deconstruct_brep_8 = DeconstructBrep(Brep=center_box_8)  # -> Faces, Edges, flatten(Vertices)
division_11 = Division(A=division_6, B=Slider(2, range=0..10))
point_in_breps_3 = PointInBreps(Brep=merge_2, Point=deconstruct_brep_8.Vertices, Strict=False)  # -> Inside, Index
dispatch_4 = Dispatch(List=deconstruct_brep_8.Vertices, DispatchPattern=point_in_breps_3.Inside)  # -> ListA, ListB

center_box_9 = CenterBox(Base=area_3.Centroid, X=division_7, Y=division_7, Z=division_7)
multiplication_2 = Multiplication(A=face_normals_2.Normals, B=division_7)
move_2 = Move(Geometry=center_box_9, Motion=multiplication_2)  # -> Geometry, Transform
deconstruct_brep_9 = DeconstructBrep(Brep=move_2.Geometry)  # -> flatten(Faces), Edges, Vertices
area_4 = Area(Geometry=deconstruct_brep_9.Faces)  # -> Area, Centroid
face_normals_3 = FaceNormals(Mesh=deconstruct_brep_9.Faces)  # -> Centers, flatten(Normals)
multiplication_3 = Multiplication(A=face_normals_3.Normals, B=division_8)
center_box_10 = CenterBox(Base=area_4.Centroid, X=division_8, Y=division_8, Z=division_8)
move_3 = Move(Geometry=center_box_10, Motion=multiplication_3)  # -> Geometry, Transform
deconstruct_brep_10 = DeconstructBrep(Brep=move_3.Geometry)  # -> flatten(Faces), Edges, Vertices
area_5 = Area(Geometry=deconstruct_brep_10.Faces)  # -> Area, Centroid
face_normals_4 = FaceNormals(Mesh=deconstruct_brep_10.Faces)  # -> Centers, flatten(Normals)
multiplication_4 = Multiplication(A=face_normals_4.Normals, B=division_9)
center_box_11 = CenterBox(Base=area_5.Centroid, X=division_9, Y=division_9, Z=division_9)
move_4 = Move(Geometry=center_box_11, Motion=multiplication_4)  # -> Geometry, Transform
deconstruct_brep_11 = DeconstructBrep(Brep=move_4.Geometry)  # -> flatten(Faces), Edges, Vertices
area_6 = Area(Geometry=deconstruct_brep_11.Faces)  # -> Area, Centroid
face_normals_5 = FaceNormals(Mesh=deconstruct_brep_11.Faces)  # -> Centers, flatten(Normals)
multiplication_5 = Multiplication(A=face_normals_5.Normals, B=division_10)
center_box_12 = CenterBox(Base=area_6.Centroid, X=division_10, Y=division_10, Z=division_10)
move_5 = Move(Geometry=center_box_12, Motion=multiplication_5)  # -> Geometry, Transform
volume_2 = Volume(Geometry=center_box_7)  # -> Volume, Centroid
point_in_brep_2 = PointInBrep(Brep=center_box_3, Point=flatten(volume_2.Centroid), Strict=True)
division_12 = Division(A=division_3, B=Slider(2, range=0..10))
dispatch_5 = Dispatch(List=flatten(center_box_7), DispatchPattern=point_in_brep_2)  # -> ListA, ListB
merge_3 = Merge(Data1=center_box_5)  # -> flatten(Result)
merge_4 = Merge(Data1=center_box_5, Data2=move.Geometry)  # -> flatten(Result)
merge_5 = Merge(Data1=center_box_5, Data2=move.Geometry, Data3=move_2.Geometry)  # -> flatten(Result)
merge_6 = Merge(Data3=move_2.Geometry, Data4=move_3.Geometry)  # -> flatten(Result)
merge_7 = Merge(Data4=move_3.Geometry, Data5=move_4.Geometry)  # -> flatten(Result)
merge_8 = Merge(Data5=move_4.Geometry, Data6=move_5.Geometry)  # -> flatten(Result)
brep_3 = Brep(dispatch_5.ListA)
brep_4 = Brep(dispatch_5.ListB)
stream_filter = StreamFilter(
    Gate=Slider(0, range=0..3),
    Stream0=center_box_3,
    Stream1=[center_box_3, center_box_4],
    Stream2=[center_box_3, center_box_4, brep_4])

# ---- group: RH_IN:step
number_slider_4 = Slider(5, range=0..5)

# ----
panel = Panel(dispatch_5.ListA)
deconstruct_brep_12 = DeconstructBrep(Brep=brep_4)  # -> Faces, Edges, Vertices
center_box_13 = CenterBox(Base=deconstruct_brep_12.Vertices, X=division_12, Y=division_12, Z=division_12)
volume_3 = Volume(Geometry=center_box_13)  # -> Volume, Centroid
panel_2 = Panel(dispatch_5.ListB)
stream_filter_2 = StreamFilter(
    Gate=number_slider_4,
    Stream0=merge_3,
    Stream1=merge_4,
    Stream2=merge_5,
    Stream3=merge_6,
    Stream4=merge_7,
    Stream5=merge_8)
center_box_14 = CenterBox(Base=dispatch_4.ListB, X=division_11, Y=division_11, Z=division_11)

# ---- group: RH_IN:step1
number_slider_5 = Slider(4, range=0..4)

# ----
point_in_brep_3 = PointInBrep(Brep=center_box_4, Point=flatten(volume_3.Centroid), Strict=True)

# ---- group: RH_OUT:mesh
mesh = Mesh(stream_filter_2)

# ----
merge_9 = Merge(Data1=center_box_3, Data2=center_box_4, Data3=center_box_7)  # -> flatten(Result)
merge_10 = Merge(Data1=center_box_3, Data2=center_box_4, Data3=center_box_7, Data4=center_box_8)  # -> flatten(Result)
merge_11 = Merge(Data1=center_box_3, Data2=center_box_4)  # -> flatten(Result)
merge_12 = Merge(Data1=center_box_3, Data2=center_box_4, Data3=center_box_7, Data4=center_box_8, Data5=center_box_14)  # -> flatten(Result)
dispatch_6 = Dispatch(List=flatten(center_box_13), DispatchPattern=point_in_brep_3)  # -> ListA, ListB
stream_filter_3 = StreamFilter(Gate=number_slider_5, Stream0=center_box_3, Stream1=merge_11, Stream2=merge_9, Stream3=merge_10, Stream4=merge_12)
brep_5 = Brep(dispatch_6.ListA)
brep_6 = Brep(dispatch_6.ListB)
panel_3 = Panel(dispatch_6.ListA)
panel_4 = Panel(dispatch_6.ListB)
